# Grasshopper definition 2D topological skeleton.gh (Grasshopper 1.0.7)
# plug-ins: Sandbox Topology

# ----
# 2D Topological Skeleton Line based on Maximal Disks Method
# Outside boundary curve of the shape to be analyzed. should be one planar and closed curve.
outside_boundary_crv = Curve(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)

# ----
# Hole(s) curves, should be planar and closed.
holes_crv = Curve([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])

entwine = Entwine(Branch00=outside_boundary_crv, Branch01=holes_crv, FlattenInputs=True)

# ----
# Dividing the curves based on their length to generate points on the edges of the shape.
resoloution = Slider(2.5, range=0.5..2.5)
explode = Explode(Curve=entwine, Recursive=True)  # -> Segments, Vertices
len = Length(Curve=explode.Segments)
multiplication = Multiplication(A=len, B=resoloution)
divide = DivideCurve(Curve=explode.Segments, Count=multiplication, Kinks=False)  # -> Points, Tangents, Parameters

flatten = FlattenTree(Tree=divide.Points, Path="{0}")

panel = Panel("removing duplicated points")
cset = CreateSet(List=flatten)  # -> Set, Map

# ----
# constructing the mesh using delanauy triangulation, based on shape edges, and removing faces inside holes.
del = DelaunayMesh(Points=cset.Set, Plane=PlaneXY(0, 0, 0))
demesh = DeconstructMesh(Mesh=del)  # -> Vertices, Faces, Colours, Normals
facen = FaceNormals(Mesh=del)  # -> Centers, Normals
boundary = Curve(outside_boundary_crv)
hole_s = Curve(holes_crv)
incurves = PointInCurves(Point=facen.Centers, Curves=hole_s)  # -> Relationship, Index, Point
incurve = PointInCurve(Point=facen.Centers, Curve=boundary)  # -> Relationship, Point
expression = Expression(x=incurve.Relationship, Expression="if (x=0,0,1)")
expression_2 = Expression(x=incurves.Relationship, Expression="if (x=2,0,1)")
and = GateAnd(A=expression, B=expression_2)
cull = CullPattern(List=demesh.Faces, CullPattern=and)
conmesh = ConstructMesh(Vertices=demesh.Vertices, Faces=cull)

# ----
# drawing circumcircle of each face (each triangle)
deface = DeconstructFace(Face=cull)  # -> CornerA, CornerB, CornerC, CornerD
merge = Merge(Data1=graft(deface.CornerA), Data2=graft(deface.CornerB), Data3=graft(deface.CornerC))
item = ListItem(List=demesh.Vertices, Index=merge, Wrap=True)
fcircle = CircleFit(Points=item)  # -> Circle, Radius, Deviation

mesh_topo_edge = MeshTopologyEdge(Mesh=conmesh)  # -> ListOfEdges, FaceFaceStructure, EdgeFaceStructure
panel_2 = Panel("Finding adjacent faces")

# ----
# center point of circumcircles
darc = DeconstructArc(Arc=fcircle.Circle)  # -> BasePlane, Radius, Angle
pt = Point(darc.BasePlane)

# ----
# connecting adjacent points together
item_2 = ListItem(List=flatten(pt), Index=mesh_topo_edge.FaceFaceStructure, Wrap=True)
ln = Line(StartPoint=item_2, EndPoint=pt)

skeleton_lines = Curve(ln)
preview = CustomPreview(Geometry=skeleton_lines, Material=ColourSwatch(SwatchColor=RGB(255, 105, 51)))
